vi "RiskReduction2.gvi"   [LabVIEW NXG 2.0.0]
panel controls:
  "Input": f64
panel indicators:
  "Result1": f64
  "Result3": f64
diagram:
  Add($Input, 5) -> w1
  Multiply(w1, 2) -> w2
  $Result1 <- w2
  Subtract(x=w2, y=5) -> w3
  $Result3 <- w3
